# Grasshopper definition RS.gh (Grasshopper 0.9.76)

panel = Panel("""1
2
3
4""")
c_script = CSharpScript(array=panel, Reference="D:\CS\COMPUTERGRAPHICS\HW\8\RS_GH\GH\RS_GH_CS.dll")  # -> out, r_array, n; inputs array: list of Int32
# ---------- c_script: C# ----------
    var api_cs_in = new RS_GH_CS.RS.API_CS();
    var api_cs_out = new RS_GH_CS.RS.API_CS();

    api_cs_in.array = array.ToArray();
    api_cs_in.n = array.Count;

    RS_GH_CS.RS.RS_CS(api_cs_in, out api_cs_out);

    r_array = api_cs_out.array;
    n = api_cs_out.n;
# ---------- end c_script ----------
panel_2 = Panel(c_script.n)
