# Grasshopper definition ubpa.gh (Grasshopper 0.9.76)
# plug-ins: MeshEdit Components, UbpaGH

# 网格规模
meshsize = Slider(100, range=0..100)
# 曲线控制点
curveptnum = Slider(11, range=0..100)

# ----
# 生成曲线
integer = Integer(curveptnum)
brep = Brep(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)
box = Box(brep)
populate_3d = Populate3D(Region=box, Count=integer, Seed=Slider(620, range=0..1000))
# 查看曲线
interpolate = Interpolate(Vertices=populate_3d, Degree=3, Periodic=True, KnotStyle=1)  # -> Curve, Length, Domain

# ----
# 生成Mesh
integer_2 = Integer(meshsize)
curve = Curve(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)
mesh_plane = MeshPlane(Boundary=curve, WidthCount=integer_2, HeightCount=integer_2)  # -> Mesh, Area
mesh_triangulate = MeshTriangulate(Mesh=mesh_plane.Mesh, ShortDiagonal=True)
deconstruct_mesh = DeconstructMesh(Mesh=mesh_triangulate)  # -> Vertices, Faces, Colours, Normals
mesh_nakededge = MeshNakedEdge(Mesh=mesh_triangulate)  # -> V, A, B
list_item = ListItem(List=mesh_nakededge.V, Index=mesh_nakededge.A, Wrap=True)
curve_2 = Curve(curve)
curve_closest_point = CurveClosestPoint(Point=list_item, Curve=reparameterize(curve_2))  # -> Point, Parameter, Distance
curve_3 = Curve(interpolate.Curve)
evaluate_curve = EvaluateCurve(Curve=reparameterize(curve_3), Parameter=curve_closest_point.Parameter)  # -> Point, Tangent, Angle
point = Point(deconstruct_mesh.Vertices)
replace_items = ReplaceItems(List=point, Item=evaluate_curve.Point, Indices=mesh_nakededge.A, Wrap=False)
construct_mesh = ConstructMesh(Vertices=replace_items, Faces=deconstruct_mesh.Faces)
deconstruct_mesh_2 = DeconstructMesh(Mesh=construct_mesh)  # -> Vertices, Faces, Colours, Normals
# 查看网格
construct_mesh_2 = ConstructMesh(Vertices=deconstruct_mesh_2.Vertices, Faces=deconstruct_mesh_2.Faces)

# ----
# 输入
# 图片
# 固定点
panel = Panel("C:\Users\Administrator\Pictures\warp_test.bmp")
# 图片的地址修改一下，图片在文件夹image里
panel_2 = Panel("""{0.0,0.0,0.0}
{0.0,0.0,0.0}
{0.0,0.0,0.0}
{0.0,0.0,0.0}""")
panel_3 = Panel("""{1.0,1.0,0.0}
{254.0,254.0,0.0}
{254.0,1.0,0.0}
{1.0,254.0,0.0}""")
panel_4 = Panel("""{-5.0,-40.0,0.0}
{-10.0,40.0,0.0}
{-40.0,10.0,0.0}
{40.0,10.0,0.0}
{0.0,0.0,0.0}
{0.0,0.0,0.0}
{0.0,0.0,0.0}
{0.0,0.0,0.0}""")
panel_5 = Panel("""{128.0,60.0,0.0}
{128.0,196.0,0.0}
{60.0,128.0,0.0}
{196.0,128.0,0.0}
{1.0,1.0,0.0}
{254.0,254.0,0.0}
{254.0,1.0,0.0}
{1.0,254.0,0.0}""")
# 实验2 + 实验3
img = ImportImage(File=panel)

# ----
# 实验4
number_slider = Slider(400, range=50..400)
# 总共有10000个点
# 运算需要点时间
# 大概10s内
# 控制曲线上点的个数
geometry = Geometry(interpolate.Curve)
mesh = Mesh(construct_mesh_2)
# 闭合曲线的最小曲面
minsrfcurve = MinSrfCurve(Curve=reparameterize(geometry), PointNum=number_slider)  # disabled
# 最小曲面——局部法
minsrflocal = MinSrfLocal(Mesh=mesh)  # disabled
# 最小曲面——全局法
minsrfglobal = MinSrfGlobal(Mesh=mesh)  # disabled

# ----
# 原图
point_2 = Point(panel_2)
point_3 = Point(panel_3)
mesh_2 = Mesh(img)
warprect = WarpRect(Image=mesh_2, P=point_3, Fp=point_2)
warptrir = WarpTriR(Image=mesh_2, P=point_3, Fp=point_2)
warpidw = WarpIDW(Image=mesh_2, P=point_3, Fp=point_2)
warptrif = WarpTriF(Image=mesh_2, P=point_3, Fp=point_2)
warprbf = WarpRBF(Image=mesh_2, P=point_3, Fp=point_2)

# ----
# 扭曲图
mesh_3 = Mesh(img)
point_4 = Point(panel_5)
point_5 = Point(panel_4)
# 矩形网格
warprect_2 = WarpRect(Image=mesh_3, P=point_4, Fp=point_5)
# 随机三角网格
warptrir_2 = WarpTriR(Image=mesh_3, P=point_4, Fp=point_5)
# 特征点三角网格
warptrif_2 = WarpTriF(Image=mesh_3, P=point_4, Fp=point_5)
# RBF
warprbf_2 = WarpRBF(Image=mesh_3, P=point_4, Fp=point_5)
# IDW
warpidw_2 = WarpIDW(Image=mesh_3, P=point_4, Fp=point_5)

# ----
# Enable
mesh_4 = Mesh(minsrfcurve)  # disabled
# WSL
srfparam_fb_wls = SrfParam_FB_WLS(Mesh=mesh_4)  # -> Mesh, TexCoord_X, TexCoord_Y
# SP
srfparam_fb_sp = SrfParam_FB_SP(Mesh=mesh_4)  # -> Mesh, TexCoord_X, TexCoord_Y
# ARAP
srfparam_ufb_arap = SrfParam_UFB_ARAP(Mesh=mesh_4)  # -> Mesh, TexCoord_X, TexCoord_Y
# 实验5
# Uniform
srfparam_fb_u = SrfParam_FB_U(Mesh=mesh_4)  # -> Mesh, TexCoord_X, TexCoord_Y

# ----
# 贴图
panel_6 = Panel("C:\Users\Administrator\Pictures\tex_line.bmp")
img_2 = ImportImage(File=panel_6)
img_3 = ImportImage(File="C:\Users\Administrator\Pictures\tex_wood.bmp")
img_4 = ImportImage(File="C:\Users\Administrator\Pictures\tex_stone.bmp")
img_5 = ImportImage(File="C:\Users\Administrator\Pictures\tex_square.bmp")

# ----
# 简单贴图
mesh_5 = Mesh(srfparam_ufb_arap.Mesh)
mesh_6 = Mesh(srfparam_fb_wls.Mesh)
mesh_7 = Mesh(img_5)
mesh_8 = Mesh(srfparam_fb_sp.Mesh)
mesh_9 = Mesh(srfparam_fb_u.Mesh)
simpletexture = SimpleTexture(Mesh=mesh_9, Image=mesh_7)
simpletexture_2 = SimpleTexture(Mesh=mesh_8, Image=mesh_7)
simpletexture_3 = SimpleTexture(Mesh=mesh_5, Image=mesh_7)
simpletexture_4 = SimpleTexture(Mesh=mesh_6, Image=mesh_7)

# ----
# Balls
# Bunny Head
# Cat Head
# David Head
mesh_10 = Mesh(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)
mesh_11 = Mesh(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)
mesh_12 = Mesh(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)
mesh_13 = Mesh(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)

# ----
# Uniform
# WSL
# SP
# ARAP
mesh_14 = Mesh(mesh_12)
srfparam_fb_wls_2 = SrfParam_FB_WLS(Mesh=mesh_14)  # -> Mesh, TexCoord_X, TexCoord_Y
srfparam_fb_sp_2 = SrfParam_FB_SP(Mesh=mesh_14)  # -> Mesh, TexCoord_X, TexCoord_Y
srfparam_ufb_arap_2 = SrfParam_UFB_ARAP(Mesh=mesh_14)  # -> Mesh, TexCoord_X, TexCoord_Y
srfparam_fb_u_2 = SrfParam_FB_U(Mesh=mesh_14)  # -> Mesh, TexCoord_X, TexCoord_Y

# ----
# 正确的贴图
操作方法 = Panel("""1. 鼠标右键点击电池，选择烘焙
2. Rhino中选中烘焙出的网格
3. 面板->物件属性->材质->物件->贴图->颜色->tex_*.bmp""")
