# Grasshopper definition TF_INTRPL.gh (Grasshopper 0.9.76)
# plug-ins: Python Interpreter, TFINTRPL

t = Slider(0, range=0..1)
c_script = CSharpScript(t=t)  # -> out, t0, t1, t2, s; inputs t: Double
# ---------- c_script: C# ----------
    t0 = t;

    if(t < 0.5){
      t1 = 2 * t;
      t2 = 0;
      s = 1;
    }
    else{
      t1 = 1.0;
      t2 = 2 * (t - 0.5);
      s = -1;
    }
# ---------- end c_script ----------
mesh = Mesh(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)

# ----
# Demo2
# 球点
size = Slider(10, range=0..10)
R = Slider(200, range=0..200)
multiplication = Multiplication(A=size, B="2")
mesh_sphere = MeshSphere(Base=PlaneXY(0, 0, 0), Radius=R, UCount=size, VCount=multiplication)
deconstruct_mesh = DeconstructMesh(Mesh=mesh_sphere)  # -> Vertices, Faces, Colours, Normals

# ----
# 镜头控制
number_slider = Slider(15, range=0..100)
number = Number(c_script.t0)
curve = Curve(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)
evaluate_curve = EvaluateCurve(Curve=reparameterize(curve), Parameter=number)  # -> Point, Tangent, Angle
construct_point = ConstructPoint(XCoordinate=0, YCoordinate=0, ZCoordinate=Slider(-40, range=-100..0))
python_script = PythonScript(x=number_slider, a="Perspective", b=evaluate_curve.Point, c=construct_point)  # -> out; inputs b: Point3d, c: Point3d
# ---------- python_script: Python ----------
import rhinoscriptsyntax as rs
rs.ViewCameraTarget(a,b,c)
rs.ViewCameraLens(a, x)
# ---------- end python_script ----------

# ----
# 将mesh以x轴旋转，并移到球点
axis = Panel("{1,0,0}")
mesh_2 = Mesh(mesh)
vector = Vector(deconstruct_mesh.Vertices)
pi = Pi(Factor=Slider(1, range=0..2))
rotate_3d = Rotate3D(Geometry=mesh_2, Angle=pi, Center=Point(0, 0, 0), Axis=axis)  # -> Geometry, Transform
vector_2 = Vector(vector)
move = Move(Geometry=rotate_3d.Geometry, Motion=vector_2)  # -> Geometry, Transform

mesh_3 = Mesh(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)
pi_2 = Pi(Factor=Slider(1.6, range=0..2))
axis_2 = Panel("{1,1,1}")
rotate_3d_2 = Rotate3D(Geometry=mesh_3, Angle=pi_2, Center=Point(0, 0, 0), Axis=axis_2)  # -> Geometry, Transform
mesh_4 = Mesh(mesh_3)

# ----
# A(t)
# R
# Demo1
# T
number_slider_2 = Slider(11, range=0..20)
t_2 = Slider(0.54, range=0..1)

vector_xyz = VectorXYZ(XComponent=number_slider_2, YComponent=Slider(5, range=0..20), ZComponent=Slider(16, range=0..20))  # -> Vector, Length
move_2 = Move(Geometry=rotate_3d_2.Geometry, Motion=vector_xyz.Vector)  # -> Geometry, Transform

tf_intrpl = TF_INTRPL(StartMesh=mesh_4, EndMesh=move_2.Geometry, T=t_2)  # -> ResultMesh, Transform

deconstruct_mesh_2 = DeconstructMesh(Mesh=[mesh_4, tf_intrpl.ResultMesh, move_2.Geometry])  # -> Vertices, Faces, Colours, Normals
colour_m0 = ColourSwatch(SwatchColor=RGBA(255, 0, 0, 64))
colour_mt = ColourSwatch(SwatchColor=RGB(0, 212, 255))
colour_m1 = ColourSwatch(SwatchColor=RGBA(51, 255, 0, 64))
construct_mesh = ConstructMesh(Vertices=deconstruct_mesh_2.Vertices, Faces=deconstruct_mesh_2.Faces)  # -> flatten(Mesh)
custom_preview = CustomPreview(Geometry=construct_mesh, Shader=[colour_m0, colour_mt, colour_m1])

transform_matrix = TransformMatrix(tf_intrpl.Transform, Digits=3)
transform_matrix_2 = TransformMatrix(rotate_3d_2.Transform, Digits=3)
transform_matrix_3 = TransformMatrix(move_2.Transform, Digits=3)

point = Point(deconstruct_mesh.Vertices)
t1 = Number(c_script.t1)
mesh_5 = Mesh(mesh)
t2 = Number(c_script.t2)
s = Number(c_script.s)
t_3 = Number(c_script.t0)

# ----
# 插值1
tf_intrpl_2 = TF_INTRPL(StartMesh=mesh_5, EndMesh=move.Geometry, T=t1)  # -> ResultMesh, Transform
transform_matrix_4 = TransformMatrix(tf_intrpl_2.Transform, Digits=3)
mesh_6 = Mesh(tf_intrpl_2.ResultMesh)

# ----
# 以x轴方向球点为中心旋转，并打乱
number_slider_3 = Slider(0.5, range=0..2)
mesh_7 = Mesh(mesh_6)
point_2 = Point(point)
vector_xyz_2 = VectorXYZ(XComponent=Slider(300, range=0..300), YComponent=0, ZComponent=0)  # -> Vector, Length
move_3 = Move(Geometry=mesh_7, Motion=vector_xyz_2.Vector)  # -> Geometry, Transform
move_4 = Move(Geometry=point_2, Motion=vector_xyz_2.Vector)  # -> Geometry, Transform
pi_3 = Pi(Factor=number_slider_3)
rotate_3d_3 = Rotate3D(Geometry=move_3.Geometry, Angle=pi_3, Center=move_4.Geometry, Axis=vector_xyz_2.Vector)  # -> Geometry, Transform
jitter = Jitter(List=rotate_3d_3.Geometry, Jitter=1, Seed=2)  # -> Values, Indices

# ----
# 插值2
tf_intrpl_3 = TF_INTRPL(StartMesh=mesh_6, EndMesh=jitter.Values, T=t2)  # -> ResultMesh, Transform
transform_matrix_5 = TransformMatrix(tf_intrpl_3.Transform, Digits=3)
mesh_8 = Mesh(tf_intrpl_3.ResultMesh)

mesh_9 = Mesh(mesh_6)
mux = CSharpScript(A=mesh_9, B=mesh_8, s=s)  # -> out, C; inputs A: list of Mesh, B: list of Mesh, s: Double
# ---------- mux: C# ----------
    if(s < 0)
      C = A;
    else
      C = B;
# ---------- end mux ----------

# ----
# 颜色
list_length = ListLength(List=mux.C)
t_4 = Number(t_3)
random = Random(Range=Domain(0, 1), Number=list_length, Seed=list_length)
cube = Cube(Value=list_length)
graph_mapper = GraphMapper(random, x0=0, x1=1, y0=0, y1=1, container_name="Bezier", cpx=[0, 1, 0, 1], cpy=[0, 0.4927536249, 1, 1])
square_root = SquareRoot(Value=cube)
division = Division(A=t_4, B="2")
jitter_2 = Jitter(List=graph_mapper, Jitter=1, Seed=cube)  # -> Values, Indices
addition = Addition(A=division, B=Slider(0.5, range=0..1))
jitter_3 = Jitter(List=jitter_2.Values, Jitter=1, Seed=square_root)  # -> Values, Indices
multiplication_2 = Multiplication(A=jitter_2.Values, B=addition)
multiplication_3 = Multiplication(A=graph_mapper, B=addition)
multiplication_4 = Multiplication(A=jitter_3.Values, B=addition)
number_2 = Number(addition)

deconstruct_mesh_3 = DeconstructMesh(Mesh=mux.C)  # -> Vertices, Faces, Colours, Normals
colour_rgb_f = ColourRGBF(Alpha=number_2, Red=multiplication_3, Green=multiplication_2, Blue=multiplication_4)
construct_mesh_2 = ConstructMesh(Vertices=deconstruct_mesh_3.Vertices, Faces=deconstruct_mesh_3.Faces)  # -> flatten(Mesh)
custom_preview_2 = CustomPreview(Geometry=construct_mesh_2, Shader=colour_rgb_f)
